# Grasshopper definition stender_genererer.gh (Grasshopper 1.0.8)

base = Surface(<surface referenced from the Rhino model>)
surface = Surface(<surface referenced from the Rhino model>)
sdivide = DivideSurface(Surface=base, UCount=10, VCount=10)  # -> Points, Normals, Parameters
vec = VectorXYZ(XComponent=0, YComponent=0, ZComponent=1)  # -> Vector, Length
line = LineSDL(Start=sdivide.Points, Direction=vec.Vector, Length=1)
slx = SurfaceLine(Surface=surface, Line=line, LimitToFirst=False)  # -> Curves, Points, UVPoints, Normal
line_2 = LineSDL(Start=slx.Points, Direction=vec.Vector, Length=1)
material = CreateMaterial(
    Diffuse=ColourSwatch(SwatchColor=RGB(139, 255, 77)),
    Specular=RGB(255, 255, 255),
    Emission=RGB(0, 0, 0),
    Transparency=0,
    Shine=0)
material_2 = CreateMaterial(
    Diffuse=ColourSwatch(SwatchColor=RGB(255, 153, 0)),
    Specular=RGB(255, 255, 255),
    Emission=RGB(0, 0, 0),
    Transparency=0,
    Shine=0)
material_3 = CreateMaterial(
    Diffuse=ColourSwatch(SwatchColor=RGB(135, 255, 249)),
    Specular=RGB(255, 255, 255),
    Emission=RGB(0, 0, 0),
    Transparency=0,
    Shine=0)
slx_2 = SurfaceLine(Surface=base, Line=line_2, LimitToFirst=False)  # -> Curves, Points, UVPoints, Normal
ln = Line(StartPoint=slx_2.Points, EndPoint=slx.Points)
preview = CustomPreview(Geometry=slx_2.Points, Material=material)
preview_2 = CustomPreview(Geometry=ln, Material=material_2)
preview_3 = CustomPreview(Geometry=slx.Points, Material=material_3)
