# Grasshopper definition unnamed.gh (Grasshopper 1.0.8)
# plug-ins: RhinoCodePluginGH

base_surface = Surface(<surface referenced from the Rhino model>)
sdivide = DivideSurface(Surface=base_surface, UCount="9", VCount="9")  # -> Points, Normals, Parameters
devec = DeconstructVector(Vector=sdivide.Points)  # -> XComponent, YComponent, ZComponent
cs = CSharpScript(x=devec.YComponent, y=devec.XComponent)  # -> out, generated_z; inputs x: Double, y: Double
# ---------- cs: C# ----------
// Grasshopper Script Instance
using System;
using System.Collections;
using System.Collections.Generic;
using System.Drawing;

using Rhino;
using Rhino.Geometry;

using Grasshopper;
using Grasshopper.Kernel;
using Grasshopper.Kernel.Data;
using Grasshopper.Kernel.Types;

public class Script_Instance : GH_ScriptInstance
{
  /* 
    Members:
      RhinoDoc RhinoDocument
      GH_Document GrasshopperDocument
      IGH_Component Component
      int Iteration

    Methods (Virtual & overridable):
      Print(string text)
      Print(string format, params object[] args)
      Reflect(object obj)
      Reflect(object obj, string method_name)
  */
  
  private void RunScript(double x, double y, ref object generated_z)
  {
    generated_z = Math.Sin(y * 0.3) * Math.Sin(x * 0.3) + 1.0;
  }
}
# ---------- end cs ----------
addition = Addition(A="9", B="1")
vec = VectorXYZ(XComponent=devec.XComponent, YComponent=devec.YComponent, ZComponent=cs.generated_z)  # -> Vector, Length
srfgrid = SurfaceFromPoints(Points=flatten(vec.Vector), UCount=addition, Interpolate=False)

md_slider = MDSlider(
    SliderMode=0,
    slider_value=Point(0.4975609756, 0.4967066599, 0.5),
    x_domain=Domain(0, 1),
    y_domain=Domain(0, 1),
    z_domain=Domain(0, 1))
pdecon = Deconstruct(Point=sdivide.Points)  # -> XComponent, YComponent, ZComponent
division = Division(A=md_slider, B="9")
bnd = Bounds(Numbers=flatten(pdecon.YComponent))
bnd_2 = Bounds(Numbers=flatten(pdecon.XComponent))
pdecon_2 = Deconstruct(Point=division)  # -> XComponent, YComponent, ZComponent
remap = RemapNumbers(Value=pdecon_2.YComponent, Source=Domain(0, 1), Target=bnd)  # -> Mapped, Clipped
remap_2 = RemapNumbers(Value=pdecon_2.XComponent, Source=Domain(0, 1), Target=bnd_2)  # -> Mapped, Clipped
sdivide_2 = DivideSurface(Surface=base_surface, UCount="9", VCount="9")  # -> Points, Normals, Parameters
pt = ConstructPoint(XCoordinate=remap_2.Mapped, YCoordinate=remap.Mapped, ZCoordinate=0)
addition_2 = Addition(A=sdivide_2.Parameters, B=pt)
iso = IsoCurve(Surface=base_surface, UVPoint=addition_2)  # -> UIsocurve, VIsocurve
project = Project(Curve=iso.UIsocurve, Brep=srfgrid, Direction=Vector(0, 0, 1))
project_2 = Project(Curve=iso.VIsocurve, Brep=srfgrid, Direction=Vector(0, 0, 1))
rulesrf = RuledSurface(CurveA=project_2, CurveB=iso.VIsocurve)
rulesrf_2 = RuledSurface(CurveA=project, CurveB=iso.UIsocurve)

material = CreateMaterial(
    Diffuse=ColourSwatch(SwatchColor=RGB(71, 182, 255)),
    Specular=RGB(255, 255, 255),
    Emission=RGB(0, 0, 0),
    Transparency=0,
    Shine=0)
preview = CustomPreview(Geometry=srfgrid, Material=material)
iso_2 = IsoCurve(Surface=base_surface, UVPoint=sdivide.Parameters)  # -> UIsocurve, VIsocurve
material_2 = CreateMaterial(
    Diffuse=ColourSwatch(SwatchColor=RGB(51, 255, 0)),
    Specular=RGB(255, 255, 255),
    Emission=RGB(0, 0, 0),
    Transparency=0,
    Shine=0)
material_3 = CreateMaterial(
    Diffuse=ColourSwatch(SwatchColor=RGB(255, 0, 0)),
    Specular=RGB(255, 255, 255),
    Emission=RGB(0, 0, 0),
    Transparency=0,
    Shine=0)
project_3 = Project(Curve=iso_2.UIsocurve, Brep=srfgrid, Direction=Vector(0, 0, 1))
project_4 = Project(Curve=iso_2.VIsocurve, Brep=srfgrid, Direction=Vector(0, 0, 1))
preview_2 = CustomPreview(Geometry=rulesrf_2, Material=material_2)
preview_3 = CustomPreview(Geometry=rulesrf, Material=material_3)
